# Grasshopper definition point_cloud.gh (Grasshopper 0.9.76)

largura_apoios = Slider(30, range=0..60)
altura = Slider(201, range=0..220)
n_cabos = Slider(6, range=2..6)
horiz_div = Slider(15, range=2..20)
subdiv = Slider(2, range=1..6)

altura_cabo_a = Slider(189, range=10..200)
altura_cabo_a_2 = Slider(149, range=10..200)
altura_cabo_a_3 = Slider(112, range=10..200)
dist_centro = Slider(14, range=10..30)
dist_centro_2 = Slider(30, range=10..30)
dist_centro_3 = Slider(30, range=10..30)

c_script = CSharpScript(
    Largura=largura_apoios,
    Altura=altura,
    horiz_div=horiz_div,
    subdiv=subdiv,
    N_cabos=n_cabos,
    dist_centro=[dist_centro, dist_centro_2, dist_centro_3],
    h_cabos=[altura_cabo_a, altura_cabo_a_2, altura_cabo_a_3])  # -> Debug, Cloud; inputs Largura: Double, Altura: Int32, horiz_div: Double, subdiv: Double, N_cabos: Int32, dist_centro: list of Int32, h_cabos: list of Int32
# ---------- c_script: C# ----------
    List<Point3d> Pt_cloud = new List<Point3d>(); // no programa final usar 2D array !!! [x,y,z]

    int x = 0;
    int y = 1;
    int h = 1;
    bool reverse = false;

    //#######################//
    //Tilt calc + N of rings //
    //#######################//
    double ring_z_step = (Altura) / horiz_div; // ok

    double tilt;
    tilt = (Largura * 0.5) / (Altura) * ring_z_step; //ok

    //##################//
    //main pt cloud loop//
    //##################//

    //Pts apoio
    Pt_cloud.Add(new Point3d(0, 0, 0));
    Pt_cloud.Add(new Point3d(Largura, 0, 0));
    Pt_cloud.Add(new Point3d(Largura, Largura, 0));
    Pt_cloud.Add(new Point3d(0, Largura, 0));

    for(h = 1; h <= horiz_div - 1; h++){ // ring loop

      double scale_factor = (1 - (h / horiz_div));
      double step = h * tilt;

      if(!reverse){ // x++ y++

        for(x = 0;x <= subdiv; x++){

          Pt_cloud.Add(new Point3d(step + x * (Largura / subdiv) * scale_factor, step, h * ring_z_step));

          if (x == subdiv){

            for(y = 1;y <= subdiv; y++){

              Pt_cloud.Add(new Point3d(Largura - step, step + y * (Largura / subdiv) * scale_factor, h * ring_z_step));

              if(x == subdiv && y == subdiv){reverse = true;} // start backwards loop
            }
          }
        }

      }

      if(reverse){ // x-- y--
        for(x = (int) subdiv - 1;x >= 0; x--){
          Pt_cloud.Add(new Point3d(step + x * (Largura / subdiv) * scale_factor, Largura - step, h * ring_z_step));

          if (x == 0){
            for(y = (int) subdiv - 1;y >= 1; y--){
              Pt_cloud.Add(new Point3d(step, step + y * (Largura / subdiv) * scale_factor, h * ring_z_step));


            }
          }
        }
      }

      reverse = false;
    }
    
    ///////////////////////////
    //#######################//
    //######## Arms #########//
    //#######################//
    ///////////////////////////
    
    
    for(int n = 0;n < (N_cabos / 2);n++){   //for each set of cables
      
      int init_h = find_nearest(h_cabos[n], horiz_div, ring_z_step); //encontrar os horiz ring + perto

      double arm_lenght = Math.Abs(dist_centro[n] - (Largura * 0.5 - init_h * tilt));
      
      //lower arm angle
      double XY_m = (Largura * 0.5 - init_h * tilt) / arm_lenght; //inclinação da reta Y=mx em XY
      double XZ_m = (h_cabos[n] - init_h * ring_z_step) / arm_lenght; //inclinação da reta Z=mx em XZ
      
      //upper arm angle
      double XZ_m_upp = (h_cabos[n] - (init_h + 1) * ring_z_step) / arm_lenght;


      //############//
      //#lower arms#//
      //###########//

      //right
      //1st lower arm
      for(int _subdiv = 1;_subdiv <= 5;_subdiv++){ // criar variavel se necessario controlo sobre o refinamento do braço
        
        double _x = (Largura - init_h * tilt) + (arm_lenght / 5) * _subdiv;
        
        if(_subdiv == 5){
          Pt_cloud.Add(new Point3d(_x, Largura * 0.5, h_cabos[n]));
          break;
        }
        Pt_cloud.Add(new Point3d(_x, init_h * tilt + XY_m * (_x - (Largura - init_h * tilt)), init_h * ring_z_step + XZ_m * (_x - (Largura - init_h * tilt))));//1st lower arm
      }

      //2nd lower arm
      for(int _subdiv = 1;_subdiv < 5;_subdiv++){ // nao "<=" para nao criar 2 pts de convergencia
        double _x = (Largura - init_h * tilt) + (arm_lenght / 5) * _subdiv;
        Pt_cloud.Add(new Point3d(_x, Largura - init_h * tilt - XY_m * (_x - (Largura - init_h * tilt)), init_h * ring_z_step + XZ_m * (_x - (Largura - init_h * tilt))));
      }
      
      //left
      //1st lower arm
      for(int _subdiv = 1;_subdiv <= 5;_subdiv++){ // criar variavel se necessario controlo sobre o refinamento do braço
        
        double _x = ( init_h * tilt) - (arm_lenght / 5) * _subdiv;
        
        if(_subdiv == 5){
          Pt_cloud.Add(new Point3d(_x, Largura * 0.5, h_cabos[n]));
          break;
        }
        
        Pt_cloud.Add(new Point3d(_x, init_h * tilt - XY_m * (_x - init_h * tilt), init_h * ring_z_step - XZ_m * (_x - init_h * tilt)));//1st lower arm
      }

      //2nd lower arm
      for(int _subdiv = 1;_subdiv < 5;_subdiv++){ // nao "<=" para nao criar 2 pts de convergencia
        double _x = ( init_h * tilt) - (arm_lenght / 5) * _subdiv;
        
        Pt_cloud.Add(new Point3d(_x, Largura - init_h * tilt + XY_m * (_x - init_h * tilt), init_h * ring_z_step - XZ_m * (_x - init_h * tilt)));
      }

      //############//
      //#Upper arms#//
      //############//

      //right
      //1st upper arm
      for(int _subdiv = 1;_subdiv < 5;_subdiv++){ // criar variavel se necessario controlo sobre o refinamento do braço
        double _x = (Largura - init_h * tilt) + (arm_lenght / 5) * _subdiv;

        Pt_cloud.Add(new Point3d(_x, init_h * tilt + XY_m * (_x - (Largura - init_h * tilt)), (init_h + 1) * ring_z_step + XZ_m_upp * (_x - (Largura - init_h * tilt))));
      }
      //2nd upper arm
      for(int _subdiv = 1;_subdiv < 5;_subdiv++){ // nao "<=" para nao criar 2 pts de convergencia
        double _x = (Largura - init_h * tilt) + (arm_lenght / 5) * _subdiv;

        Pt_cloud.Add(new Point3d(_x, Largura - init_h * tilt - XY_m * (_x - (Largura - init_h * tilt)), (init_h + 1) * ring_z_step + XZ_m_upp * (_x - (Largura - init_h * tilt))));
      }

      //left
      //1st upper arm
      for(int _subdiv = 1;_subdiv < 5;_subdiv++){ // criar variavel se necessario controlo sobre o refinamento do braço
        double _x = (init_h * tilt) - (arm_lenght / 5) * _subdiv;

        Pt_cloud.Add(new Point3d(_x, init_h * tilt - XY_m * (_x - init_h * tilt), (init_h + 1) * ring_z_step - XZ_m_upp * (_x - init_h * tilt)));
      }
      //2nd upper arm
      for(int _subdiv = 1;_subdiv < 5;_subdiv++){ // nao "<=" para nao criar 2 pts de convergencia
        double _x = (init_h * tilt) - (arm_lenght / 5) * _subdiv;

        Pt_cloud.Add(new Point3d(_x, Largura - init_h * tilt + XY_m * (_x - init_h * tilt), (init_h + 1) * ring_z_step - XZ_m_upp * (_x - init_h * tilt)));
      }
    }

    Cloud = Pt_cloud;
# ---------- c_script: C# additional code ----------
  private int find_nearest(int altura, double horiz_div, double ring_z_step){
    int nearest = -1;
    double dist = 10000;

    for (int h = 1; h <= horiz_div - 2; h++){
      if(dist > Math.Abs(altura - h * ring_z_step)){
        dist = Math.Abs(altura - h * ring_z_step);
        nearest = h;
      }
    }

    return nearest;
  }
# ---------- end c_script ----------
panel = Panel(c_script.Debug)
c_script_2 = CSharpScript(Cloud=c_script.Cloud, subdiv=subdiv, horiz_div=horiz_div)  # -> Debug, bars; inputs Cloud: list of Point3d, subdiv: Int32, horiz_div: Int32
# ---------- c_script_2: C# ----------
    List<Line> Lines = new List<Line>();
    //
    //Connect support pts
    //
    //add Lcr
    for(int i = 0; i <= 4;i++){

      if (i == 0){
        for (int j = 4;j <= 4 + subdiv;j++){
          Lines.Add(new Line(Cloud[0], Cloud[j]));
        }
        for (int j = 8 + 4 * (subdiv - 1) - 1;j >= 8 + 4 * (subdiv - 1) - subdiv;j--){
          Lines.Add(new Line(Cloud[0], Cloud[j]));
        }

      }
      if (i == 1){
        for (int j = 4;j <= 4 + 2 * subdiv;j++){
          Lines.Add(new Line(Cloud[1], Cloud[j]));
        }
      }
      if (i == 2){
        for (int j = 4 + subdiv;j <= 4 + 3 * subdiv;j++){
          Lines.Add(new Line(Cloud[2], Cloud[j]));
        }
      }
      if (i == 3){
        for (int j = 4 + subdiv * 2;j <= 4 + 4 * subdiv - 1;j++){
          Lines.Add(new Line(Cloud[3], Cloud[j]));
        }
        Lines.Add(new Line(Cloud[3], Cloud[4]));
      }
    }

    //Connect all other points
    //add Lcr nesta fase !!!
    int ring_pt = 4 + (subdiv - 1) * 4;
    //init and end pts
    for(int h = 0; h <= horiz_div - 3;h++){

      // Lado +XX
      for(int i = 4 + ring_pt * h;i < 4 + ring_pt * (h + 1);i++){//init coord.
        //lados
        if(i == 4 + ring_pt * h){//cantos
          for(int j = 4 + ring_pt * (h + 1);j <= subdiv + 4 + ring_pt * (h + 1) - 1;j++){ //-1 para nao conectar a diagonal oposta
            Lines.Add(new Line(Cloud[i], Cloud[j]));
          }
        }else if(i == 4 + ring_pt * h + subdiv){
          for(int j = 4 + ring_pt * (h + 1) + 1;j <= subdiv + 4 + ring_pt * (h + 1) - 1;j++){ //+1 para nao conectar a diagonal oposta
            Lines.Add(new Line(Cloud[i], Cloud[j])); //quando i = j-ring_pt  id bar as active(always)
          }
        }else{ //pts centrais
          if(i > 4 + ring_pt * h && i < 4 + ring_pt * h + subdiv){
            for(int j = 4 + ring_pt * (h + 1);j <= subdiv + 4 + ring_pt * (h + 1);j++){
              Lines.Add(new Line(Cloud[i], Cloud[j]));
            }
          }
        }
      }
      // Lado +YY
      for(int i = 4 + subdiv + ring_pt * h;i < 4 + subdiv + ring_pt * (h + 1);i++){//init coord.

        //lados
        if(i == 4 + subdiv + ring_pt * h){//cantos
          for(int j = 4 + subdiv + ring_pt * (h + 1);j <= 2 * subdiv + 4 + ring_pt * (h + 1) - 1;j++){
            Lines.Add(new Line(Cloud[i], Cloud[j]));
          }
        }else if(i == 4 + ring_pt * h + 2 * subdiv){
          for(int j = 4 + subdiv + ring_pt * (h + 1) + 1;j <= 2 * subdiv + 4 + ring_pt * (h + 1) - 1;j++){
            Lines.Add(new Line(Cloud[i], Cloud[j]));
          }

        }else{ //pts centrais
          if(i > 4 + subdiv + ring_pt * h && i < 4 + ring_pt * h + 2 * subdiv){
            for(int j = 4 + subdiv + ring_pt * (h + 1);j <= 2 * subdiv + 4 + ring_pt * (h + 1);j++){
              Lines.Add(new Line(Cloud[i], Cloud[j]));
            }
          }
        }
      }

      // Lado -XX
      for(int i = 4 + 2 * subdiv + ring_pt * h;i < 4 + 2 * subdiv + ring_pt * (h + 1);i++){//init coord.
        //lados
        if(i == 4 + 2 * subdiv + ring_pt * h){//cantos
          for(int j = 4 + 2 * subdiv + ring_pt * (h + 1);j <= 3 * subdiv + 4 + ring_pt * (h + 1) - 1;j++){
            Lines.Add(new Line(Cloud[i], Cloud[j]));
          }
        }else if(i == 4 + ring_pt * h + 3 * subdiv){
          for(int j = 4 + 2 * subdiv + ring_pt * (h + 1) + 1;j <= 3 * subdiv + 4 + ring_pt * (h + 1) - 1;j++){
            Lines.Add(new Line(Cloud[i], Cloud[j]));
          }
        }else{ //pts centrais
          if(i > 4 + 2 * subdiv + ring_pt * h && i < 4 + ring_pt * h + 3 * subdiv){
            for(int j = 4 + 2 * subdiv + ring_pt * (h + 1);j <= 3 * subdiv + 4 + ring_pt * (h + 1);j++){
              Lines.Add(new Line(Cloud[i], Cloud[j]));
            }
          }
        }
      }

      // Lado -YY
      for(int i = 4 + 3 * subdiv + ring_pt * h;i < 4 + 3 * subdiv + ring_pt * (h + 1);i++){//init coord.
        //lados
        if(i == 4 + 3 * subdiv + ring_pt * h){//cantos
          for(int j = 4 + 3 * subdiv + ring_pt * (h + 1);j <= 4 * subdiv + 4 + ring_pt * (h + 1) - 1;j++){
            Lines.Add(new Line(Cloud[i], Cloud[j]));

            if(j != 4 + 3 * subdiv + ring_pt * (h + 1) ){ //exceto lado oposto
              Lines.Add(new Line(Cloud[4 + ring_pt * h], Cloud[j]));
            } //conect first corner w/ side -YY

          }
        }else{ //pts centrais
          if(i > 4 + 3 * subdiv + ring_pt * h && i < 4 + ring_pt * h + 4 * subdiv){
            for(int j = 4 + 3 * subdiv + ring_pt * (h + 1);j <= 4 * subdiv + 4 + ring_pt * (h + 1) - 1;j++){
              Lines.Add(new Line(Cloud[i], Cloud[j]));
            }
            Lines.Add(new Line(Cloud[i], Cloud[4 + ring_pt * (h + 1)])); //conect to init pt
          }
        }
      }

    }

    // Horizontal connections
    //add Lcr nesta fase!!!
    for(int h = 0; h <= horiz_div - 2;h++){
      for(int i = 4 + h * ring_pt;i < 4 + (h +1) * ring_pt - 1;i++){
        Lines.Add(new Line(Cloud[i], Cloud[i + 1]));
        if(i == 4 + (h + 1 ) * ring_pt - 2){
          Lines.Add(new Line(Cloud[i+1], Cloud[4 + h * ring_pt]));
        }
      }
    }

    //
    bars = Lines;
# ---------- end c_script_2 ----------
panel_2 = Panel(c_script.Cloud)
panel_3 = Panel(c_script_2.bars)
